# Grasshopper definition gh_script.gh (Grasshopper 1.0.7)

brep = Brep([<brep referenced from the Rhino model> x4])
brep_2 = Brep([<brep referenced from the Rhino model> x6])
# Input Brep
merge = Merge(Data1=brep_2, Data2=brep)
brep_3 = Brep(merge)

simplify_brep = GhPythonScript(Bs=brep_3, min_area="0.001")  # -> out, Faces, Planes, test_faces, delete_faces; inputs Bs: list of Brep
# ---------- simplify_brep: Python ----------
__author__ = "ziqwang"

import rhinoscriptsyntax as rs
import ghpythonlib.components as gh

Faces = []
Planes = []

test_faces = []
delete_faces = []
for brep in Bs:
    F = gh.DeconstructBrep(brep)[0]
    
    result_polyline = []
    result_plane = []
    
    if type(F) != type(list()):
        F = [F]
        
    for f in F:
        area = gh.Area(f)[0]
        planar = gh.IsPlanar(f, False)[0]
        if area > min_area and planar == True:
            
            plane = gh.EvaluateSurface(f, gh.ConstructPoint(0,0,0))[4]
            
            vertices = gh.DeconstructBrep(f)[2]            
            result_polyline.append(f)
            result_plane.append(plane)
            #Polylines = polyline
            #Planes = plane
            test_faces.append(f)
        else:
            delete_faces.append(f)
    
    Faces.append(result_polyline)
    Planes.append(result_plane)
# ---------- end simplify_brep ----------
volume = Volume(Geometry=brep_3)  # -> Volume, Centroid
brep_4 = Brep(simplify_brep.test_faces)
brep_5 = Brep(simplify_brep.delete_faces)
identify_contact = GhPythonScript(Faces=simplify_brep.Faces, Planes=simplify_brep.Planes, Cts=volume.Centroid, max_dist="3")  # -> graph, debug, contact_faces; inputs Faces: list, Planes: list, Cts: list of Point3d
# ---------- identify_contact: Python ----------
__author__ = "ziqwang"

import rhinoscriptsyntax as rs
import ghpythonlib.components as gh
import math

angle_eps = 1 / 180.0 * math.pi
dist_eps = 0.1

#check func
contact_faces = []

def check_blocks_in_contact(blockI, blockJ):    
    
    contact_normals = []
    for faceI in range(0, len(Planes[blockI])):
        for faceJ in range(0, len(Planes[blockJ])):
            
            planeI = Planes[blockI][faceI]
            planeJ = Planes[blockJ][faceJ]
                    
            normalI = gh.DeconstructPlane(planeI)[3]
            normalJ = gh.DeconstructPlane(planeJ)[3]
            
            ptI = gh.DeconstructPlane(planeI)[0]
            ptJ = gh.DeconstructPlane(planeJ)[0]
            
            ptIJ = gh.Subtraction(ptJ, ptI)
            dist = gh.DotProduct(ptIJ, normalI, False)
            #print(dist)
            angle = gh.Angle(normalI, normalJ)[0]
            if abs(angle - math.pi) < angle_eps and dist < dist_eps and dist >= 0:
                data = [blockI, blockJ, normalI[0], normalI[1], normalI[2]]
                contact_normals.append(data)
                
                contact_faces.append(Faces[blockI][faceI])
                contact_faces.append(Faces[blockJ][faceJ])
    
    if contact_normals != []:
        return [True, contact_normals]
    else:
        return [False, contact_normals]


#main

debug = "["
graph = []
N = len(Planes)
for blockI in range(0, N):
    for blockJ in range(blockI + 1, N):
        ctI = Cts[blockI]
        ctJ = Cts[blockJ]
        #dist = gh.VectorLength(ctI - ctJ)
        dist = 0
        if dist < max_dist:            
            [in_contact, result_datas] = check_blocks_in_contact(blockI, blockJ)
            if in_contact  == True:
                for data in result_datas:
                    debug+= "[{}, {}, {}, {}, {}],\n".format(*data)
                    graph.append(data)

debug += "]"
# ---------- end identify_contact ----------
panel = Panel(identify_contact.debug)
brep_6 = Brep(identify_contact.contact_faces)
panel_2 = Panel("""6
7
8
9""")
brep_7 = Brep([<brep referenced from the Rhino model> x4])
panel_3 = Panel("""0
1
2
3
4
5""")
evalsrf = EvaluateSurface(Surface=brep_7, Point="0,0")  # -> Point, Normal, UDirection, VDirection, Frame
mult_directions = GhPythonScript(graph=identify_contact.graph, candidate=panel_2, boundary=panel_3)  # -> out, vec; inputs graph: list, candidate: list of Int32, boundary: list of Int32
# ---------- mult_directions: Python ----------
__author__ = "ziqwang"

import rhinoscriptsyntax as rs
import ghpythonlib.components as gh

from compas.rpc import Proxy

gkr_solver = Proxy('gkr_mult_drt_robot.solver.multiple_directions_calculator')
result = gkr_solver.compute_simultaneous_translational_disassembling_directions_without_guidance(graph, candidate, boundary)

vec = []
if result[0] == True:
    velocities = result[1]
    for id in range(0, len(candidate)):
        velocity = gh.ConstructPoint(velocities[id][0], velocities[id][1], velocities[id][2])
        vec.append(velocity)
else:
    vec = [gh.VectorXYZ(0, 0, 0) for x in range(0, len(candidate))]
# ---------- end mult_directions ----------
mult_directions_2 = GhPythonScript(graph=identify_contact.graph, guidance=evalsrf.Normal, candidate=panel_2, boundary=panel_3)  # -> out, vec; inputs graph: list, guidance: list of Vector3d, candidate: list of Int32, boundary: list of Int32
# ---------- mult_directions_2: Python ----------
__author__ = "ziqwang"

import rhinoscriptsyntax as rs
import ghpythonlib.components as gh

from compas.rpc import Proxy

gkr_solver = Proxy('gkr_mult_drt_robot.solver.multiple_directions_calculator')

#guidance
guidance_vec = []
for g in guidance:
    guidance_vec.append([g[0], g[1], g[2]])

result = gkr_solver.compute_simultaneous_translational_disassembling_directions_with_guidance(graph, candidate, boundary, guidance_vec)

vec = []
if result[0] == True:
    velocities = result[1]
    for id in range(0, len(candidate)):
        velocity = gh.ConstructPoint(velocities[id][0], velocities[id][1], velocities[id][2])
        vec.append(velocity)
else:
    vec = [gh.VectorXYZ(0, 0, 0) for x in range(0, len(candidate))]
# ---------- end mult_directions_2 ----------
unit = UnitVector(Vector=mult_directions.vec)
item = ListItem(List=brep_3, Index=panel_2, Wrap=True)
multiplication = Multiplication(A=unit, B=Slider(0, range=0..1))
item_2 = ListItem(List=brep_3, Index=panel_3, Wrap=True)  # -> flatten(Item)
move = Move(Geometry=item, Motion=multiplication)  # -> flatten(Geometry), Transform
merge_2 = Merge(Data1=move.Geometry, Data2=item_2)
brep_8 = Brep(merge_2)
